# Grasshopper definition Morphing_with_Interpolation_on_Multiple_Curves_Animation.ghx (Grasshopper 0.9.76)
# plug-ins: Python Interpreter, Mesh Pipe

crv = Curve([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])
bbox = BoundingBox(Content=crv, Plane=PlaneXY(0, 0, 0))  # -> Box, Box_2
area = Area(Geometry=bbox.Box)  # -> Area, Centroid
end = EndPoints(Curve=crv)  # -> Start, End
pdecon = Deconstruct(Point=area.Centroid)  # -> XComponent, YComponent, ZComponent
neg = Negative(Value=pdecon.XComponent)
neg_2 = Negative(Value=pdecon.YComponent)
vec = VectorXYZ(XComponent=neg, YComponent=neg_2, ZComponent=0)  # -> Vector, Length
move = Move(Geometry=crv, Motion=vec.Vector)  # -> Geometry, Transform
sort = SortList(Keys=pdecon.XComponent, ValuesA=move.Geometry)  # -> Keys, ValuesA
scale_nu = ScaleNU(Geometry=sort.ValuesA, Plane=PlaneXY(0, 0, 0), ScaleX=Slider(1.2, range=0..10), ScaleY=1, ScaleZ=1)  # -> Geometry, Transform
yz = YZPlane(Origin=Point(0, 0, 0))
rotate = Rotate(Geometry=scale_nu.Geometry, Angle=1.570796327, Plane=yz)  # -> Geometry, Transform
python = PythonScript(CURVES=rotate.Geometry, DIV_COUNT=Slider(150, range=0..250), SEQ_COUNT=Slider(15, range=0..100))  # -> CRUVES_w_SEQ, DOMAIN, LAST_FRAME, DEBUG; inputs CURVES: list of Curve
# ---------- python: Python ----------
import rhinoscriptsyntax as rs
import Rhino.Geometry as rg



### Divide Curve
def divide_crvs(crvs, div_count):
    points_div = []
    
    for i in xrange(len(crvs)):
        tmp_pts = rs.DivideCurve(crvs[i], div_count)
        points_div.append(tmp_pts)
    
    # print points_div
    # print len(points_div)
    # print len(points_div[0])
    
    ### 2D Array
    return points_div



### Flip 2D Array
def flip_2d_array(array_2d):
    
    array_2d_f = list(map(list, zip(*array_2d)))
    # print len(array_2d_f)
    # print len(array_2d_f[0])
    
    return array_2d_f



### InterpCrv
def interp_crvs(array_2d_f):
    in_crvs = []
    
    for i in xrange(len(array_2d_f)):
        crv = rs.AddInterpCurve(array_2d_f[i])
        in_crvs.append(crv)
    
    return in_crvs



### Slice Sequence
def slice_sequence(crvs, seq_count):
    
    pt_slice = []
    
    frame = 1 / seq_count
    # print frame
    
    
    for i in xrange(len(crvs)):
        crv = crvs[i]
        crv = rs.coercecurve(crv)
        start_pt, end_pt = rs.CurveDomain(crv)
        # print start_pt, "to", end_pt ### [0 to len(Curves)]
        
        param_slice = []
        for j in xrange(int(end_pt)):
            
            for k in xrange(seq_count):
                value = j + k*frame
                param_slice.append(value)
        
        param_slice.append(end_pt)
        
        # print param_slice
        # print len(param_slice)
        
        sub_list = []
        for l in xrange(len(param_slice)):
            pt = rg.Curve.PointAt(crv, param_slice[l])
            sub_list.append(pt)
        
        pt_slice.append(sub_list)
    
    return pt_slice



### Generate Frame
def generate_frame(pt_array):
    
    crv_frame = []
    for i in xrange(len(pt_array)):
        
        pt_list = []
        tmp_list = pt_array[i]
        
        ### closed, add -1
        for j in xrange(len(tmp_list)):
            pt_list.append(tmp_list[j])
        
        ### Closed
        # pt_list.append(tmp_list[0])
        
        crv = rs.AddInterpCurve(pt_list)
        rs.CloseCurve(crv)
        crv_frame.append(crv)
    
    return crv_frame






pts_div_crv = divide_crvs(CURVES, DIV_COUNT)
pts_div_crv_flip = flip_2d_array(pts_div_crv)

crvs_interpolate = interp_crvs(pts_div_crv_flip)

pt_slice = slice_sequence(crvs_interpolate, SEQ_COUNT)
pt_slice_flip = flip_2d_array(pt_slice)

crvs_all_frame = generate_frame(pt_slice_flip)



### Output
CRUVES_w_SEQ = crvs_all_frame
DOMAIN = rg.Interval(0, len(crvs_all_frame)- 1)
LAST_FRAME = len(crvs_all_frame)
# ---------- end python ----------
viewer = ParamViewer(python.CRUVES_w_SEQ)
panel = Panel("C:\Users\yoshioca\Documents\3D_Morphing_Models_MetaBall\Text_Pipe_DANCING\FBX\")
crv_2 = Curve(python.CRUVES_w_SEQ)
crv_3 = Curve(python.CRUVES_w_SEQ)
panel_2 = Panel(python.LAST_FRAME)
panel_3 = Panel(python.DOMAIN)
mpipe = MeshPipe(Curve=crv_2, Radius=Slider(0.75, range=0..1), Accuracy=Slider(0.05, range=0..0.1), Rotation=0, Segments=10, Caps=2)
python_2 = PythonScript(MESHES=mpipe, path=panel, type=".fbx", BOOL=Toggle(False))  # -> out, a; inputs MESHES: list of Mesh
# ---------- python_2: Python ----------
import Rhino
import rhinoscriptsyntax as rs
import scriptcontext as sc


sc.doc = ghdoc

if BOOL:
    
    sc.doc = Rhino.RhinoDoc.ActiveDoc
    
    for i in xrange(len(MESHES)):
        
        mesh = MESHES[i]
        sc.doc.Objects.AddMesh(mesh)
        
        name_format = "%03d"%i
        export_name = path + str(name_format) + type
        
        
        query = ' _SelAll _-Export '+ \
            export_name + \
           " _Enter " + \
           " _Enter " + \
           " _SelAll _Delete"
        
        
        rs.Command(query)
    
        #print(query)
# ---------- end python_2 ----------
viewer_2 = ParamViewer(python.CRUVES_w_SEQ)
remap = RemapNumbers(Value=Slider(0.79, range=0..1), Source="0 to 1", Target=panel_3)  # -> Mapped, Clipped
panel_4 = Panel(python_2.a)
item = ListItem(List=crv_3, Index=remap.Mapped, Wrap=True)
Z = UnitZ(Factor=1)
move_2 = Move(Geometry=item, Motion=Z)  # -> Geometry, Transform
colour = ColourPicker(PickedColour=RGB(255, 255, 255))
colour_2 = ColourPicker(PickedColour=RGB(0, 0, 0))
brep = Brep(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)
preview = CustomPreview(Geometry=brep, Shader=colour)
preview_2 = CustomPreview(Geometry=move_2.Geometry, Shader=colour_2)
